# Grasshopper definition agent-based-reef.gh (Grasshopper 1.0.8)
# plug-ins: RhinoCodePluginGH

hexagon_reef = Geometry(<brep referenced from the Rhino model>)
pt = Point(<point referenced from the Rhino model>)
square_reef = Geometry(<extrusion referenced from the Rhino model>)
mesh = Mesh(<mesh referenced from the Rhino model>)
popgeo = PopulateGeometry(Geometry=mesh, Count=100, Seed=1)
random = Random(Range=Domain(0, 1), Number=1, Seed=popgeo)  # -> flatten(Random)
sph = Sphere(Base=popgeo, Radius=random)
scale = Scale(Geometry=popgeo, Center=Point(0, 0, 0), Factor=Slider(0.95, range=0..1))  # -> Geometry, Transform
sdiff = SolidDifference(BrepsA=square_reef, BrepsB=sph)
brep = Brep(<brep referenced from the Rhino model>)
py3 = Python3Script()  # -> out, a
# ---------- py3: Python ----------
import Rhino.Geometry as rg

# Create a Box
corner1 = rg.Point3d(0, 0, 0)
corner2 = rg.Point3d(10, 10, 10)
box = rg.Box(rg.Plane.WorldXY, rg.Interval(0, 10), rg.Interval(0, 10), rg.Interval(0, 10))

# Create a Brep from the Box
brep = box.ToBrep()
# ---------- end py3 ----------
brep_2 = Brep(py3.a)
porosity_generator = Python3Script(input_geometry=brep, input_points=scale.Geometry)  # -> out, modified_mesh
# ---------- porosity_generator: Python ----------
# requirements: numpy, scipy
import Rhino.Geometry as rg
import rhinoscriptsyntax as rs
import random

# Define the Agent class
class PorosityAgent:
    def __init__(self, position, radius):
        """
        Initializes the agent.

        Parameters:
        - position: A Rhino.Geometry.Point3d representing the agent's position.
        - radius: The radius of the spherical void created by the agent.
        """
        self.position = position
        self.radius = radius

    def create_void(self):
        """
        Creates a spherical void at the agent's position.

        Returns:
        - A Rhino.Geometry.Sphere.
        """
        return rg.Sphere(self.position, self.radius)

# Function to apply porosity to the geometry
def apply_porosity(input_geometry, points):
    """
    Applies porosity to the given geometry by subtracting spherical voids.

    Parameters:
    - input_geometry: The base Rhino.Geometry.Brep.
    - points: A list of Rhino.Geometry.Point3d defining the void locations.

    Returns:
    - A new Rhino.Geometry.Brep with porosity applied.
    """
    if not isinstance(input_geometry, rg.Brep):
        raise ValueError("Input geometry must be a Brep.")

    # Create a copy of the input geometry to modify
    modified_geometry = input_geometry.DuplicateBrep()

    # Create a list to hold the spherical voids
    voids = []

    # Create agents for each point and generate voids
    for point in points:
        radius = random.uniform(1, 5)  # Random radius between 1 and 5
        agent = PorosityAgent(point, radius)
        voids.append(agent.create_void())

    # Convert spheres to Breps and subtract them from the geometry
    void_breps = [sphere.ToBrep() for sphere in voids]
    for void_brep in void_breps:
        boolean_result = rg.Brep.CreateBooleanDifference([modified_geometry], [void_brep], 0.01)
        if boolean_result:
            modified_geometry = boolean_result[0]

    return modified_geometry

# Grasshopper inputs
# input_geometry: The base geometry (Brep) from Grasshopper
# input_points: A list of points (Point3d) from Grasshopper
if 'input_geometry' in globals() and 'input_points' in globals():
    try:
        # Run the porosity function
        output_geometry = apply_porosity(input_geometry, input_points)
    except Exception as e:
        output_geometry = None
        print(f"Error: {e}")
else:
    output_geometry = None
    print("Error: Ensure 'input_geometry' and 'input_points' are connected in Grasshopper.")
# ---------- end porosity_generator ----------
py3_2 = Python3Script(input_brep=brep)  # -> out, a
# ---------- py3_2: Python ----------
import Rhino.Geometry as rg

def brep_to_mesh(input_brep):
    """
    Convert a Brep (solid or surface) into a Mesh.
    
    Parameters:
    - input_brep: A Rhino Brep object to be converted into a Mesh.
    
    Returns:
    - A Rhino Mesh object created from the input Brep.
    """
    # Ensure the input is a valid Brep
    if not isinstance(input_brep, rg.Brep):
        raise ValueError("Input geometry must be a Brep.")
    
    # Convert Brep to Mesh
    mesh_list = rg.Mesh.CreateFromBrep(input_brep)
    
    # If mesh creation was successful, return the first mesh (in case of multiple)
    if mesh_list and len(mesh_list) > 0:
        return mesh_list[0]
    else:
        raise ValueError("Mesh creation from Brep failed.")
# ---------- end py3_2 ----------
mesh_2 = Mesh(py3_2.a)
panel = Panel(porosity_generator.modified_mesh)
brep_3 = Brep(porosity_generator.modified_mesh)
mesh_3 = Mesh(porosity_generator.modified_mesh)
